# Grasshopper definition Simple_pick_place_from_geo_and_json_creation.ghx (Grasshopper 1.0.7)

pt = Point(Point(500, 500, 0))
path = FilePath("C:\Users\indra\repos\mmec_fab\examples\frames.json")
panel = Panel(path)
pln = Plane(pt)
series = Series(Start=0, Step=Slider(100, range=0..100), Count=Slider(3, range=0..10))
pflip = FlipPlane(Plane=pln, ReverseX=False, ReverseY=False, SwapAxes=True)
X = UnitX(Factor=series)
Y = UnitY(Factor=Slider(100, range=0..100))
Y_2 = UnitY(Factor=Slider(100, range=0..100))
move = Move(Geometry=pflip, Motion=X)  # -> Geometry, Transform
move_2 = Move(Geometry=move.Geometry, Motion=Y)  # -> Geometry, Transform
move_3 = Move(Geometry=move_2.Geometry, Motion=Y_2)  # -> Geometry, Transform
xy = XYPlane(Origin=Point(0, 0, 0))
python = GhPythonScript(pick_planes=move.Geometry, place_planes=move_2.Geometry, run=Button())  # -> out, a; inputs pick_planes: list of Plane, place_planes: list of Plane
# ---------- python: Python ----------
from mmec_fab import RobotClient

if run:
    with RobotClient() as client:
        client.pre()
    
        for pick, place in zip(pick_planes, place_planes):
            client.pick_place(pick, place)
        
        client.post()
# ---------- end python ----------
python_2 = GhPythonScript(pick_planes=move.Geometry, place_planes=move_2.Geometry, travel_planes=move_3.Geometry, file_path=path, save=Button())  # -> out, a; inputs pick_planes: list of Plane, place_planes: list of Plane, travel_planes: list of Plane, save: Boolean
# ---------- python_2: Python ----------
from compas import json_dump

from mmec_fab import rgplane_to_cgframe

# for loop example
pick_frames = []
for plane in pick_planes:
    frame = rgplane_to_cgframe(plane)
    pick_frames.append(frame)

# list comprehension example
place_frames = [rgplane_to_cgframe(plane) for plane in place_planes]

travel_frames = [rgplane_to_cgframe(plane) for plane in place_planes]

data = {
        "pick_frames": pick_frames,
        "place_frames": place_frames,
        "travel_frames": travel_frames
        }

if save:
    json_dump(data, file_path)
# ---------- end python_2 ----------
